# Dynamo graph FollowingSurface.dyn (Dynamo 0.9.0.3067)

# group: Rebar Options
rebar_bar_type = RebarBarType("#11")
rebar_style = RebarStyle("Standard")
rebar_hook_orientation = RebarHookOrientation("Right")
rebar_hook_type = RevitRebarHookType("Standard - 180 deg.")

# group: Curvature
select_face = DSFaceSelection()  # 1 picked in the model
number = DoubleInput(6)
boolean = BoolSelector(true)
number_2 = DoubleInput(10)
coverToOffset = DynamoRebar.Rebar.CoverToOffset(number_2, rebar_bar_type)
boolean_2 = BoolSelector(false)
followingSurface = DynamoRebar.Rebar.FollowingSurface(select_face, number, arg3=boolean, arg4=coverToOffset, arg5=boolean_2)
normalAtParameter = Surface.NormalAtParameter(surface=select_face)

# group: Host Element
select_model_element = DSModelElementSelection()  # 1 picked in the model
id = Element.Id(select_model_element)

byCurve = RebarContainer.ByCurve(followingSurface, id, rebar_style, rebar_bar_type, rebar_hook_orientation, rebar_hook_orientation, rebar_hook_type, rebar_hook_type, normalAtParameter)
flatten = Flatten(followingSurface)
firstItem = List.FirstItem(flatten)
byCurve_2 = Rebar.ByCurve(firstItem, id, rebar_style, rebar_bar_type, rebar_hook_orientation, rebar_hook_orientation, rebar_hook_type, rebar_hook_type, normalAtParameter)
