# Dynamo graph Generic Foundation.dyn (Dynamo 0.9.1.2992)

views = Views("Project View")

# group: Rebar Type
rebar_hook_type = RevitRebarHookType("None")
rebar_bar_type = RebarBarType("10 220S")
rebar_hook_orientation = RebarHookOrientation("Left")

# group: Stirrup Settings
rebar_bar_type_2 = RebarBarType("10 220S")
rebar_hook_orientation_2 = RebarHookOrientation("Left")
rebar_hook_type_2 = RevitRebarHookType("None")

# group: Geometry Selection
select_face = DSFaceSelection()
select_face_2 = DSFaceSelection()
select_model_element = DSModelElementSelection()

# group: Distribution
cover_parameter = DoubleInput(400)
division = DoubleInput(4)

number = DoubleInput(200)
number_2 = DoubleInput(500)
number_3 = DoubleInput(300)
number_4 = DoubleInput(600)
foundation_rebar = Custom[Foundation Rebar](Start_Rebar_Hook_Type=rebar_hook_type, End_Rebar_Hook_Type=rebar_hook_type, Rebar_Bar_Type=rebar_bar_type, Rebar_Hook_Orientation=rebar_hook_orientation, Stirrup_Bar_Type=rebar_bar_type_2, Stirrup_Hook_Orientation=rebar_hook_orientation_2, Stirrup_Hook_Type=rebar_hook_type_2, Bottom_Face=select_face, Top_Face=select_face_2, Cover=cover_parameter, Divisions=division, Parent_Element=select_model_element, Stirrup_Overlap=number, Bottom_Hook_Length=number_2, Bottom_bending_radius=number_3, Stirrup_Stepping=number_4)  # Standard Rebar for Foundations
boolean = BoolSelector(true)
byElement = Tag.ByElement(views, foundation_rebar.Stirrups, boolean, boolean)
