# Dynamo graph Shorten.dyn (Dynamo 0.8.1.1942)

# group: Curvature
select_face = DSFaceSelection()  # 1 picked in the model
number = DoubleInput(4)
boolean = BoolSelector(false)
number_2 = DoubleInput(0)
boolean_2 = BoolSelector(true)
followingSurface = Rebar.FollowingSurface(select_face, number, arg3=boolean, arg4=number_2, arg5=boolean_2)

# group: Shorten Curves
number_3 = DoubleInput(1000)
shorten = Rebar.Shorten(followingSurface, number_3)

# group: Host Element
select_model_element = DSModelElementSelection()  # 1 picked in the model
id = Element.Id(select_model_element)

# group: Rebar Options
rebar_style = RebarStyle("Standard")
rebar_bar_type = RebarBarType("#6")
rebar_hook_orientation = RebarHookOrientation("Right")
rebar_hook_type = RevitRebarHookType("Standard - 90 deg.")

byCurve = RebarContainer.ByCurve(shorten, id, rebar_style, rebar_bar_type, rebar_hook_orientation, rebar_hook_orientation, rebar_hook_type, rebar_hook_type)
