# Dynamo graph TagElements.dyn (Dynamo 0.9.0.3067)

# group: Views
views = Views("Level 01")

select_model_element = DSModelElementSelection()  # 1 picked in the model
boolean = BoolSelector(true)
boolean_2 = BoolSelector(false)

# group: Offset from MidPoint
code_block = CodeBlock { 1500; }
byCoordinates = Point.ByCoordinates(y=code_block)
boolean_3 = BoolSelector(true)

byElement = Tag.ByElement(views, select_model_element, boolean, boolean_2, byCoordinates, boolean_3)
