# Dynamo graph DynamoWorkspace.dyn (Dynamo 0.8.0.950)

select_model_element = DSModelElementSelection()  # 1 picked in the model
id = Element.Id(select_model_element)
select_face = DSFaceSelection()  # 1 picked in the model
number = DoubleInput(4)
boolean = BoolSelector(false)
followingSurface = Rebar.FollowingSurface(select_face, number, arg3=boolean)
select_model_element_2 = DSModelElementSelection()  # 1 picked in the model
id_2 = Element.Id(select_model_element_2)
rebar_style = RebarStyle("Standard")
rebar_bar_type = RebarBarType("#6")
rebar_hook_orientation = RebarHookOrientation("Right")
rebar_hook_type = RevitRebarHookType("Standard - 90 deg.")
ZAxis = Vector.ZAxis()
byCurve = RebarContainer.ByCurve(followingSurface, id_2, rebar_style, rebar_bar_type, rebar_hook_orientation, rebar_hook_orientation, rebar_hook_type, rebar_hook_type, ZAxis)
select_face_2 = DSFaceSelection()  # 1 picked in the model
select_faces = SelectFaces()  # 3 picked in the model
flatten = Flatten(select_faces)
number_2 = DoubleInput(0.5)
number_3 = DoubleInput(20)
boolean_2 = BoolSelector(true)
perpendicularRebar = Rebar.PerpendicularRebar(select_face_2, flatten, number_2, number_3, boolean_2)
flatten_2 = Flatten(perpendicularRebar)
byCurve_2 = RebarContainer.ByCurve(flatten_2, id_2, rebar_style, rebar_bar_type, rebar_hook_orientation, rebar_hook_orientation, rebar_hook_type, rebar_hook_type, ZAxis)
select_edge = DSEdgeSelection()  # 1 picked in the model
select_edge_2 = DSEdgeSelection()  # 1 picked in the model
number_4 = DoubleInput(10)
morphedRebar = Rebar.MorphedRebar(select_edge, select_edge_2, number_4)
byCurve_3 = RebarContainer.ByCurve(morphedRebar, id_2, rebar_style, rebar_bar_type, rebar_hook_orientation, rebar_hook_orientation, rebar_hook_type, rebar_hook_type, ZAxis)
flatten_3 = Flatten(followingSurface)
firstItem = List.FirstItem(flatten_3)
byCurve_4 = Rebar.ByCurve(firstItem, id_2, rebar_style, rebar_bar_type, rebar_hook_orientation, rebar_hook_orientation, rebar_hook_type, rebar_hook_type, ZAxis)
boolean_3 = BoolSelector(true)
boolean_4 = BoolSelector(true)
byPoint = Tag.ByPoint(byCurve_4, boolean_3, boolean_4)
